# Grasshopper definition Lines.gh (Grasshopper 1.0.7)
# plug-ins: Human

file_path = FilePath("/Users/huhuxi/Desktop/JIE LIU 3/Animal Rescue.csv")
read_file = ReadFile(File=file_path, PerLineParse=True)  # -> simplify(Content)
cull_index = CullIndex(List=read_file, Indices=Slider(0, range=0..100), Wrap=True)
text_split = TextSplit(Text=read_file, Separators=",")
text_split_2 = TextSplit(Text=cull_index, Separators=",")
panel = Panel(text_split)
list_item = ListItem(List=text_split_2, Index=Slider(2, range=0..10), Wrap=True)  # -> flatten(Item)
list_item_2 = ListItem(List=text_split_2, Index=Slider(0, range=0..10), Wrap=True)  # -> flatten(Item)
list_item_3 = ListItem(List=text_split_2, Index=Slider(3, range=0..10), Wrap=True)  # -> flatten(Item)
construct_domain = ConstructDomain(DomainStart=Slider(0, range=0..100), DomainEnd=Slider(10000, range=0..10000))
bounds = Bounds(Numbers=list_item_2)
construct_point = ConstructPoint(XCoordinate=list_item, YCoordinate=list_item_3, ZCoordinate=0)
remap_numbers = RemapNumbers(Value=list_item_2, Source=bounds, Target=construct_domain)  # -> Mapped, Clipped
larger_than = LargerThan(FirstNumber=remap_numbers.Mapped, SecondNumber=Slider(0, range=0..100))  # -> LargerThan, OrEqualTo
cull_pattern = CullPattern(List=remap_numbers.Mapped, CullPattern=larger_than.LargerThan)
item_index = ItemIndex(List=remap_numbers.Mapped, Item=cull_pattern)
list_item_4 = ListItem(List=construct_point, Index=item_index, Wrap=True)
unit_z = UnitZ(Factor=1)
list_item_5 = ListItem(List=list_item_2, Index=item_index, Wrap=True)
circle_cnr = CircleCNR(Center=list_item_4, Normal=Vector(0, 0, 1), Radius=Slider(50, range=0..100))
line_sdl = LineSDL(Start=list_item_4, Direction=unit_z, Length=cull_pattern)
createhatch = CreateHatch(Bake=False, Curves=circle_cnr, HatchPatternName="Solid", HatchScale=1, HatchRotation=0)  # -> HatchGeometry, HatchObjects
end_points = EndPoints(Curve=line_sdl)  # -> Start, End
colour_swatch = ColourSwatch(SwatchColor=RGB(216, 19, 255))
custom_preview_materials = CustomPreviewMaterials(Geometry=createhatch.HatchGeometry, DiffuseColor=colour_swatch)
text_tag_3d = TextTag3D(
    Location=end_points.End,
    Text=list_item_5,
    Size=Slider(100, range=0..100),
    Colour=ColourSwatch(SwatchColor=RGB(255, 255, 255)),
    Justification=7)
custom_preview_lineweights = CustomPreviewLineweights(Geometry=line_sdl, Shader=colour_swatch, Thickness=Slider(1, range=0..1), Absolute=False)
