# Grasshopper definition advance.gh (Grasshopper 1.0.7)
# plug-ins: Human

file_path = FilePath("D:\WORK\OneDrive - University College London\term 2 final\rewrite\Sound组前10％.csv")
file_path_2 = FilePath("D:\WORK\OneDrive - University College London\term 2 final\rewrite\Visual 2组前10％.csv")
read_file = ReadFile(File=file_path, PerLineParse=True)  # -> simplify(Content)
read_file_2 = ReadFile(File=file_path_2, PerLineParse=True)  # -> simplify(Content)
number_slider = Slider(3, range=0..10)
number_slider_2 = Slider(2, range=0..10)
number_slider_3 = Slider(8, range=0..10)
number_slider_4 = Slider(12, range=0..100)
number_slider_5 = Slider(9, range=0..10)
number_slider_6 = Slider(10, range=0..10)
number_slider_7 = Slider(14, range=0..100)
cull_index = CullIndex(List=read_file, Indices=Slider(0, range=0..100), Wrap=True)
cull_index_2 = CullIndex(List=read_file_2, Indices=Slider(0, range=0..100), Wrap=True)
text_split = TextSplit(Text=read_file, Separators=",")
text_split_2 = TextSplit(Text=read_file_2, Separators=",")
text_split_3 = TextSplit(Text=cull_index, Separators=",")
text_split_4 = TextSplit(Text=cull_index_2, Separators=",")
panel = Panel(text_split)
panel_2 = Panel(text_split_2)
list_item = ListItem(List=text_split_3, Index=Slider(1, range=0..1), Wrap=True)  # -> flatten(Item)
list_item_2 = ListItem(List=text_split_4, Index=Slider(1, range=0..1), Wrap=True)  # -> flatten(Item)
list_item_3 = ListItem(List=text_split_3, Index=Slider(2, range=0..19), Wrap=True)  # -> flatten(Item)
list_item_4 = ListItem(List=text_split_4, Index=Slider(2, range=0..19), Wrap=True)  # -> flatten(Item)
list_item_5 = ListItem(List=text_split_3, Index=Slider(3, range=0..19), Wrap=True)  # -> flatten(Item)
list_item_6 = ListItem(List=text_split_4, Index=Slider(3, range=0..19), Wrap=True)  # -> flatten(Item)
get_number = GetNumber(list_item, AtLeast=1, AtMost=2147483647, Maximum=1.797693135e+308, Minimum=-1.797693135e+308)
get_number_2 = GetNumber(list_item_2, AtLeast=1, AtMost=2147483647, Maximum=1.797693135e+308, Minimum=-1.797693135e+308)
larger_than = LargerThan(FirstNumber=get_number_2, SecondNumber=Slider(0, range=0..100))  # -> LargerThan, OrEqualTo
larger_than_2 = LargerThan(FirstNumber=get_number, SecondNumber=Slider(0, range=0..100))  # -> LargerThan, OrEqualTo
construct_point = ConstructPoint(XCoordinate=list_item_3, YCoordinate=list_item_5, ZCoordinate=0)
construct_point_2 = ConstructPoint(XCoordinate=list_item_4, YCoordinate=list_item_6, ZCoordinate=0)
cull_pattern = CullPattern(List=get_number_2, CullPattern=larger_than.LargerThan)
cull_pattern_2 = CullPattern(List=get_number, CullPattern=larger_than_2.LargerThan)
number_slider_8 = Slider(0, range=-100..10)
number_slider_9 = Slider(8000, range=4000..8000)
number_slider_10 = Slider(0, range=-100..10)
number_slider_11 = Slider(70, range=0..4000)
item_index = ItemIndex(List=get_number, Item=cull_pattern_2)
item_index_2 = ItemIndex(List=get_number_2, Item=cull_pattern)
bounds = Bounds(Numbers=cull_pattern_2)
bounds_2 = Bounds(Numbers=cull_pattern)
construct_domain = ConstructDomain(DomainStart=number_slider_8, DomainEnd=Slider(600, range=0..4000))
construct_domain_2 = ConstructDomain(DomainStart=Slider(0, range=-100..10), DomainEnd=Slider(100, range=0..4000))
construct_domain_3 = ConstructDomain(DomainStart=number_slider_10, DomainEnd=number_slider_11)
unit_z = UnitZ(Factor=1)
list_item_7 = ListItem(List=construct_point, Index=item_index, Wrap=True)
list_item_8 = ListItem(List=construct_point_2, Index=item_index_2, Wrap=True)
unit_z_2 = UnitZ(Factor=1)
number_slider_12 = Slider(4400, range=0..10000)
line_sdl = LineSDL(Start=list_item_8, Direction=unit_z, Length=cull_pattern)
remap_numbers = RemapNumbers(Value=cull_pattern, Source=bounds_2, Target=construct_domain_2)  # -> Mapped, Clipped
remap_numbers_2 = RemapNumbers(Value=cull_pattern_2, Source=bounds, Target=construct_domain_3)  # -> Mapped, Clipped
item_index_3 = ItemIndex(List=construct_point_2, Item=construct_point_2)
line_sdl_2 = LineSDL(Start=list_item_7, Direction=unit_z_2, Length=cull_pattern_2)
smaller_than = SmallerThan(FirstNumber=item_index_3, SecondNumber=number_slider_12)  # -> SmallerThan, OrEqualTo
larger_than_3 = LargerThan(FirstNumber=item_index_3, SecondNumber=number_slider_12)  # -> LargerThan, OrEqualTo
subtraction = Subtraction(A=remap_numbers_2.Mapped, B=Slider(8750, range=4000..10000))
unit_z_3 = UnitZ(Factor=subtraction)
subtraction_2 = Subtraction(A=remap_numbers.Mapped, B=Slider(8750, range=4000..10000))
unit_z_4 = UnitZ(Factor=subtraction_2)
move = Move(Geometry=list_item_8, Motion=unit_z_4)  # -> Geometry, Transform
move_2 = Move(Geometry=list_item_7, Motion=unit_z_3)  # -> Geometry, Transform
panel_3 = Panel("""False
False
True
False
False""")
number_slider_13 = Slider(400, range=0..1000)
surface = Surface(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)
delaunay_mesh = DelaunayMesh(Points=move_2.Geometry, Plane=PlaneXY(0, 0, 0))
cull_pattern_3 = CullPattern(List=move.Geometry, CullPattern=smaller_than.OrEqualTo)
number_slider_14 = Slider(10, range=0..100)
number_slider_15 = Slider(5, range=0..100)
divide_surface = DivideSurface(Surface=surface, UCount=number_slider_13, VCount=number_slider_13)  # -> Points, Normals, Parameters
unit_z_5 = UnitZ(Factor=1)
number_slider_16 = Slider(170, range=0..1000)
mesh_ray = MeshRay(Mesh=delaunay_mesh, Point=divide_surface.Points, Direction=unit_z_5)  # -> Point, Hit
number_slider_17 = Slider(50, range=0..100)
rotate = Rotate(Angle=1.570796327, Plane=PlaneXY(0, 0, 0))  # -> Geometry, Transform
voronoi_3d = Voronoi3D(Points=cull_pattern_3)  # -> Cells, Boundary
polyline = PolyLine(Vertices=mesh_ray.Point, Closed=False)  # -> flatten(Polyline)
rectangle = Rectangle(Plane=PlaneXY(0, 0, 0), XSize=number_slider_14, YSize=number_slider_14, Radius=0)  # -> Rectangle, Length
interpolate = Interpolate(Vertices=mesh_ray.Point, Degree=3, Periodic=False, KnotStyle=1)  # -> flatten(Curve), Length, Domain
deconstruct_brep = DeconstructBrep(Brep=voronoi_3d.Cells)  # -> Faces, flatten(Edges), Vertices
gradient = Gradient(
    LowerLimit=number_slider_10,
    UpperLimit=number_slider_11,
    Parameter=remap_numbers_2.Mapped,
    stops=[0: RGBA(108, 31, 171, 100), 0.36: RGBA(218, 181, 255, 100)])
explode = Explode(Curve=interpolate.Curve, Recursive=True)  # -> flatten(Segments), Vertices
length = Length(Curve=explode.Segments)
bounds_3 = Bounds(Numbers=length)
deconstruct_domain = DeconstructDomain(Domain=bounds_3)  # -> Start, End
number_slider_18 = Slider(0.1, range=0..0.1)
number_slider_19 = Slider(1, range=0..1)
panel_4 = Panel("""True
False
False
False
False""")
length_2 = Length(Curve=deconstruct_brep.Edges)
colour_swatch = ColourSwatch(SwatchColor=RGBA(54, 113, 186, 229))
colour_swatch_2 = ColourSwatch(SwatchColor=RGBA(220, 226, 232, 224))
brep = Brep([<brep referenced from the Rhino model> x5000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])
bounds_4 = Bounds(Numbers=length_2)
deconstruct_domain_2 = DeconstructDomain(Domain=bounds_4)  # -> Start, End
gradient_2 = Gradient(
    LowerLimit=deconstruct_domain_2.Start,
    UpperLimit=deconstruct_domain_2.End,
    Parameter=length_2,
    stops=[0: RGB(31, 75, 171), 0.465: RGB(181, 239, 255)])
custom_preview_lineweights = CustomPreviewLineweights(Geometry=explode.Segments, Shader=gradient, Thickness=Slider(7, range=0..10), Absolute=False)
brep_2 = Brep([<brep referenced from the Rhino model> x162])
cull_pattern_4 = CullPattern(List=flatten(deconstruct_brep.Faces), CullPattern=panel_4)
brep_3 = Brep([<brep referenced from the Rhino model> x215])
brep_4 = Brep([<brep referenced from the Rhino model> x32])
number_slider_20 = Slider(1, range=0..10)
custom_preview_lineweights_2 = CustomPreviewLineweights(
    Geometry=brep,
    Shader=ColourSwatch(SwatchColor=RGBA(252, 250, 250, 147)),
    Thickness=Slider(2, range=0..10),
    Absolute=False)
custom_preview_lineweights_3 = CustomPreviewLineweights(
    Geometry=brep_3,
    Shader=ColourSwatch(SwatchColor=RGBA(220, 226, 232, 247)),
    Thickness=Slider(2, range=0..10),
    Absolute=False)
area = Area(Geometry=cull_pattern_4)  # -> Area, Centroid
custom_preview_lineweights_4 = CustomPreviewLineweights(Geometry=deconstruct_brep.Edges, Shader=gradient_2, Thickness=number_slider_20, Absolute=False)
bounds_5 = Bounds(Numbers=area.Area)
deconstruct_domain_3 = DeconstructDomain(Domain=bounds_5)  # -> Start, End
smaller_than_2 = SmallerThan(FirstNumber=area.Area, SecondNumber=Slider(10000, range=0..30000))  # -> SmallerThan, OrEqualTo
gradient_3 = Gradient(
    LowerLimit=deconstruct_domain_3.Start,
    UpperLimit=deconstruct_domain_3.End,
    Parameter=area.Area,
    stops=[0: RGBA(31, 75, 171, 150), 0.0804: RGBA(181, 239, 255, 150)])
cull_pattern_5 = CullPattern(List=cull_pattern_4, CullPattern=smaller_than_2.SmallerThan)
area_2 = Area(Geometry=cull_pattern_5)  # -> Area, Centroid
scale = Scale(Geometry=cull_pattern_5, Center=area_2.Centroid, Factor=Slider(0.4, range=0..1))  # -> Geometry, Transform
custom_preview_lineweights_5 = CustomPreviewLineweights(Geometry=scale.Geometry, Shader=gradient_3, Thickness=number_slider_20, Absolute=False)

# ---- group: CREATE LINEAR VISUALISATIONS
file_path_3 = FilePath("D:\WORK\OneDrive - University College London\term 2 final\rewrite\Smell组前10％.csv")
read_file_3 = ReadFile(File=file_path_3, PerLineParse=True)  # -> simplify(Content)
cull_index_3 = CullIndex(List=read_file_3, Indices=Slider(0, range=0..100), Wrap=True)
number_slider_21 = Slider(2, range=0..20)
text_split_5 = TextSplit(Text=read_file_3, Separators=",")
text_split_6 = TextSplit(Text=cull_index_3, Separators=",")
list_item_9 = ListItem(List=text_split_6, Index=Slider(1, range=0..1), Wrap=True)  # -> flatten(Item)
panel_5 = Panel(text_split_5)
list_item_10 = ListItem(List=text_split_6, Index=Slider(2, range=0..19), Wrap=True)  # -> flatten(Item)
list_item_11 = ListItem(List=text_split_6, Index=Slider(3, range=0..19), Wrap=True)  # -> flatten(Item)
# Lines
construct_point_3 = ConstructPoint(XCoordinate=list_item_10, YCoordinate=list_item_11, ZCoordinate=0)
unit_z_6 = UnitZ(Factor=1)

# ----
panel_6 = Panel(cull_index_3)
get_number_3 = GetNumber(list_item_9, AtLeast=1, AtMost=2147483647, Maximum=1.797693135e+308, Minimum=-1.797693135e+308)

# ---- group: CREATE LINEAR VISUALISATIONS (continued)
larger_than_4 = LargerThan(FirstNumber=get_number_3, SecondNumber=Slider(0, range=0..100))  # -> LargerThan, OrEqualTo
cull_pattern_6 = CullPattern(List=get_number_3, CullPattern=larger_than_4.LargerThan)
item_index_4 = ItemIndex(List=get_number_3, Item=cull_pattern_6)
list_item_12 = ListItem(List=construct_point_3, Index=item_index_4, Wrap=True)
line_sdl_3 = LineSDL(Start=list_item_12, Direction=unit_z_6, Length=cull_pattern_6)

# ----
bounds_6 = Bounds(Numbers=cull_pattern_6)
remap_numbers_3 = RemapNumbers(Value=cull_pattern_6, Source=bounds_6, Target=construct_domain)  # -> Mapped, Clipped
subtraction_3 = Subtraction(A=remap_numbers_3.Mapped, B=Slider(8750, range=4000..10000))
unit_z_7 = UnitZ(Factor=subtraction_3)
end_points = EndPoints(Curve=line_sdl_3)  # -> Start, End
move_3 = Move(Geometry=list_item_12, Motion=unit_z_7)  # -> Geometry, Transform
gradient_4 = Gradient(
    LowerLimit=number_slider_8,
    UpperLimit=construct_domain,
    Parameter=remap_numbers_3.Mapped,
    stops=[0: RGB(171, 31, 31), 0.493: RGB(255, 181, 181)])
line = Line(StartPoint=list_item_12, EndPoint=move_3.Geometry)
polyline_2 = PolyLine(Vertices=move_3.Geometry, Closed=False)
rectangle_2 = Rectangle(Plane=move_3.Geometry, XSize=number_slider_15, YSize=number_slider_15, Radius=0)  # -> Rectangle, Length
explode_2 = Explode(Curve=polyline_2, Recursive=True)  # -> Segments, Vertices
custom_preview_lineweights_6 = CustomPreviewLineweights(
    Geometry=line,
    Shader={diffuse=RGB(255, 105, 180), emission=RGB(76, 32, 54), shine=0.5, specular=RGB(255, 255, 255), transparency=0},
    Absolute=False)
custom_preview_lineweights_7 = CustomPreviewLineweights(
    Geometry=explode_2.Segments,
    Shader={diffuse=RGB(255, 105, 180), emission=RGB(76, 32, 54), shine=0.5, specular=RGB(255, 255, 255), transparency=0},
    Absolute=False)
custom_preview_lineweights_8 = CustomPreviewLineweights(Geometry=rectangle_2.Rectangle, Shader=gradient_4, Thickness=Slider(10, range=0..10), Absolute=False)
