# Grasshopper definition basic.gh (Grasshopper 1.0.7)
# plug-ins: Human

# ---- group: CREATE LINEAR VISUALISATIONS
file_path = FilePath("C:\Users\Margie\Desktop\UCL\TutoringRC14_23_24\Term 01\Term01_03\Workshop material\Data Visualisation\Transportemissionstorhino.csv")
read_file = ReadFile(File=file_path, PerLineParse=True)  # -> simplify(Content)
cull_index = CullIndex(List=read_file, Indices=Slider(0, range=0..100), Wrap=True)
text_split = TextSplit(Text=read_file, Separators=",")
text_split_2 = TextSplit(Text=cull_index, Separators=",")
panel = Panel(text_split)
list_item = ListItem(List=text_split_2, Index=Slider(2, range=0..10), Wrap=True)  # -> flatten(Item)
list_item_2 = ListItem(List=text_split_2, Index=Slider(4, range=0..10), Wrap=True)  # -> flatten(Item)
list_item_3 = ListItem(List=text_split_2, Index=Slider(3, range=0..10), Wrap=True)  # -> flatten(Item)
construct_domain = ConstructDomain(DomainStart=Slider(0, range=0..100), DomainEnd=Slider(10000, range=0..10000))
bounds = Bounds(Numbers=list_item_2)
# Lines
construct_point = ConstructPoint(XCoordinate=list_item, YCoordinate=list_item_3, ZCoordinate=0)
remap_numbers = RemapNumbers(Value=list_item_2, Source=bounds, Target=construct_domain)  # -> Mapped, Clipped
larger_than = LargerThan(FirstNumber=remap_numbers.Mapped, SecondNumber=Slider(0, range=0..100))  # -> LargerThan, OrEqualTo
cull_pattern = CullPattern(List=remap_numbers.Mapped, CullPattern=larger_than.LargerThan)
item_index = ItemIndex(List=remap_numbers.Mapped, Item=cull_pattern)
list_item_4 = ListItem(List=construct_point, Index=item_index, Wrap=True)
unit_z = UnitZ(Factor=1)
circle_cnr = CircleCNR(Center=list_item_4, Normal=Vector(0, 0, 1), Radius=Slider(50, range=0..100))
line_sdl = LineSDL(Start=list_item_4, Direction=unit_z, Length=cull_pattern)
createhatch = CreateHatch(Bake=False, Curves=circle_cnr, HatchPatternName="Solid", HatchScale=1, HatchRotation=0)  # -> HatchGeometry, HatchObjects
colour_swatch = ColourSwatch(SwatchColor=RGB(216, 19, 255))
custom_preview_materials = CustomPreviewMaterials(Geometry=createhatch.HatchGeometry, DiffuseColor=colour_swatch)
custom_preview_lineweights = CustomPreviewLineweights(Geometry=line_sdl, Shader=colour_swatch, Thickness=Slider(1, range=0..1), Absolute=False)

# ---- group: SURFACE/CONTOURS
file_path_2 = FilePath("E:\Bartlett\UCL21_22\Term1\Example02\IndustrialRhino.csv")
number_slider = Slider(0, range=0..100)  # disabled
read_file_2 = ReadFile(File=file_path_2, PerLineParse=True)  # -> simplify(Content); disabled
cull_index_2 = CullIndex(List=read_file_2, Indices=number_slider, Wrap=True)  # disabled
panel_2 = Panel(",")  # disabled
text_split_3 = TextSplit(Text=read_file_2, Separators=panel_2)  # disabled
text_split_4 = TextSplit(Text=cull_index_2, Separators=panel_2)  # disabled
number_slider_2 = Slider(1, range=0..10)  # disabled
number_slider_3 = Slider(2, range=0..10)  # disabled
number_slider_4 = Slider(4, range=0..10)  # disabled
panel_3 = Panel(text_split_3)  # disabled
number_slider_5 = Slider(0, range=0..100)  # disabled
number_slider_6 = Slider(10000, range=0..10000)  # disabled
list_item_5 = ListItem(List=text_split_4, Index=number_slider_2, Wrap=True)  # -> flatten(Item); disabled
list_item_6 = ListItem(List=text_split_4, Index=number_slider_4, Wrap=True)  # -> flatten(Item); disabled
list_item_7 = ListItem(List=text_split_4, Index=number_slider_3, Wrap=True)  # -> flatten(Item); disabled
construct_domain_2 = ConstructDomain(DomainStart=number_slider_5, DomainEnd=number_slider_6)  # disabled
bounds_2 = Bounds(Numbers=list_item_6)  # disabled
construct_point_2 = ConstructPoint(XCoordinate=list_item_5, YCoordinate=list_item_7, ZCoordinate=0)  # disabled
remap_numbers_2 = RemapNumbers(Value=list_item_6, Source=bounds_2, Target=construct_domain_2)  # -> Mapped, Clipped; disabled
unit_z_2 = UnitZ(Factor=remap_numbers_2.Mapped)  # disabled
move = Move(Geometry=construct_point_2, Motion=unit_z_2)  # -> Geometry, Transform; disabled
delaunay_mesh = DelaunayMesh(Points=move.Geometry, Plane=PlaneXY(0, 0, 0))  # disabled
curve = Curve(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)  # disabled
number_slider_7 = Slider(200, range=0..200)  # disabled
number_slider_8 = Slider(100, range=0..100)  # disabled
boundary_surfaces = BoundarySurfaces(Edges=curve)  # disabled
# Contours
divide_surface = DivideSurface(Surface=boundary_surfaces, UCount=number_slider_7, VCount=number_slider_8)  # -> Points, Normals, Parameters; disabled
unit_z_3 = UnitZ(Factor=1)  # disabled
number_slider_9 = Slider(1, range=0..1)  # disabled
mesh_ray = MeshRay(Mesh=delaunay_mesh, Point=divide_surface.Points, Direction=unit_z_3)  # -> flatten(Point), Hit; disabled
addition = Addition(A=number_slider_7, B=number_slider_9)  # disabled
surface_from_points = SurfaceFromPoints(Points=mesh_ray.Point, UCount=addition, Interpolate=False)  # disabled
number_slider_10 = Slider(80, range=0..100)  # disabled
contour = Contour(Shape=surface_from_points, Point=Point(0, 0, 0), Direction=Vector(0, 0, 1), Distance=number_slider_10)  # disabled
number_slider_11 = Slider(0, range=0..1)  # disabled
colour_swatch_2 = ColourSwatch(SwatchColor=RGB(255, 255, 255))  # disabled
custom_preview_lineweights_2 = CustomPreviewLineweights(Geometry=contour, Shader=colour_swatch_2, Thickness=number_slider_11, Absolute=False)  # disabled

# ----
file_path_3 = FilePath("E:\Bartlett\UCL21_22\Term1\Example02\IndustrialRhino.csv")  # disabled
number_slider_12 = Slider(0, range=0..100)  # disabled
read_file_3 = ReadFile(File=file_path_3, PerLineParse=True)  # -> simplify(Content); disabled
cull_index_3 = CullIndex(List=read_file_3, Indices=number_slider_12, Wrap=True)  # disabled
panel_4 = Panel(",")  # disabled
text_split_5 = TextSplit(Text=read_file_3, Separators=panel_4)  # disabled
text_split_6 = TextSplit(Text=cull_index_3, Separators=panel_4)  # disabled
number_slider_13 = Slider(0, range=0..300)  # disabled
number_slider_14 = Slider(2000, range=0..10000)  # disabled
number_slider_15 = Slider(1, range=0..10)  # disabled
number_slider_16 = Slider(4, range=0..100)  # disabled
number_slider_17 = Slider(2, range=0..10)  # disabled
panel_5 = Panel(text_split_5)  # disabled
construct_domain_3 = ConstructDomain(DomainStart=number_slider_13, DomainEnd=number_slider_14)  # disabled
list_item_8 = ListItem(List=text_split_6, Index=number_slider_15, Wrap=True)  # -> flatten(Item); disabled
list_item_9 = ListItem(List=text_split_6, Index=number_slider_16, Wrap=True)  # -> flatten(Item); disabled
list_item_10 = ListItem(List=text_split_6, Index=number_slider_17, Wrap=True)  # -> flatten(Item); disabled
bounds_3 = Bounds(Numbers=list_item_9)  # disabled
remap_numbers_3 = RemapNumbers(Value=list_item_9, Source=bounds_3, Target=construct_domain_3)  # -> Mapped, Clipped; disabled
construct_point_3 = ConstructPoint(XCoordinate=list_item_8, YCoordinate=list_item_10, ZCoordinate=remap_numbers_3.Mapped)  # -> flatten(Point); disabled
curve_2 = Curve(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)  # disabled
number_slider_18 = Slider(100, range=0..200)  # disabled
number_slider_19 = Slider(100, range=0..200)  # disabled
boundary_surfaces_2 = BoundarySurfaces(Edges=curve_2)  # disabled
delaunay_mesh_2 = DelaunayMesh(Points=construct_point_3, Plane=PlaneXY(0, 0, 0))  # disabled
unit_z_4 = UnitZ(Factor=1)  # disabled
divide_surface_2 = DivideSurface(Surface=boundary_surfaces_2, UCount=number_slider_19, VCount=number_slider_18)  # -> Points, Normals, Parameters; disabled
mesh_ray_2 = MeshRay(Mesh=delaunay_mesh_2, Point=divide_surface_2.Points, Direction=unit_z_4)  # -> flatten(Point), Hit; disabled
addition_2 = Addition(A=number_slider_19, B=1)  # disabled
list_item_11 = ListItem(List=list_item_2, Index=item_index, Wrap=True)
# Surfaces
surface_from_points_2 = SurfaceFromPoints(Points=mesh_ray_2.Point, UCount=addition_2, Interpolate=False)  # disabled

number_slider_20 = Slider(88, range=0..100)  # disabled
surface = Surface(surface_from_points_2)  # disabled
divide_domain² = DivideDomain²(Domain=surface, UCount=number_slider_20, VCount=number_slider_20)  # disabled
isotrim = Isotrim(Surface=surface, Domain=divide_domain²)  # disabled
curve_3 = Curve(isotrim)  # disabled
curve_middle = CurveMiddle(Curve=curve_3)  # disabled
deconstruct = Deconstruct(Point=curve_middle)  # -> XComponent, YComponent, ZComponent; disabled
bounds_4 = Bounds(Numbers=deconstruct.ZComponent)  # disabled
deconstruct_domain = DeconstructDomain(Domain=bounds_4)  # -> Start, End; disabled
gradient = Gradient(
    LowerLimit=deconstruct_domain.Start,
    UpperLimit=deconstruct_domain.End,
    Parameter=deconstruct.ZComponent,
    stops=[0: RGB(57, 0, 153), 0.25: RGB(158, 0, 89), 0.5: RGB(225, 0, 84), 0.75: RGB(255, 84, 0), 1: RGB(255, 189, 0)])  # disabled
custom_preview = CustomPreview(Geometry=curve_3, Material=gradient)  # disabled

end_points = EndPoints(Curve=line_sdl)  # -> Start, End
text_tag_3d = TextTag3D(
    Location=end_points.End,
    Text=list_item_11,
    Size=Slider(100, range=0..100),
    Colour=ColourSwatch(SwatchColor=RGB(255, 255, 255)),
    Justification=7)

# ---- group: COLORING CONTOURS
contours = Curve(flatten([<curve referenced from the Rhino model> x2958]))  # disabled
end_points_2 = EndPoints(Curve=contours)  # -> Start, End; disabled
number_slider_21 = Slider(1, range=0..1)  # disabled
number_slider_22 = Slider(0, range=0..100)  # disabled
deconstruct_2 = Deconstruct(Point=end_points_2.End)  # -> XComponent, YComponent, flatten(ZComponent); disabled
construct_domain_4 = ConstructDomain(DomainStart=number_slider_22, DomainEnd=number_slider_21)  # disabled
bounds_5 = Bounds(Numbers=deconstruct_2.ZComponent)  # disabled
remap_numbers_4 = RemapNumbers(Value=deconstruct_2.ZComponent, Source=bounds_5, Target=construct_domain_4)  # -> Mapped, Clipped; disabled
graph_mapper = GraphMapper(
    remap_numbers_4.Mapped,
    x0=0,
    x1=1,
    y0=0,
    y1=1,
    container_name="Bezier",
    cpx=[0, 0, 0.5217391253, 1],
    cpy=[0, 0.4057971239, 0.9927536249, 1])  # disabled
gradient_2 = Gradient(
    LowerLimit=number_slider_22,
    UpperLimit=number_slider_21,
    Parameter=graph_mapper,
    stops=[0.15: RGB(255, 130, 160), 0.85: RGB(220, 0, 40)])  # disabled
custom_preview_lineweights_3 = CustomPreviewLineweights(Geometry=contours, Shader=gradient_2, Absolute=False)  # disabled
