# Grasshopper definition 01gh.gh (Grasshopper 1.0.7)

srf = Surface(<surface referenced from the Rhino model>)
flip = Flip(Surface=srf)  # -> Surface, Result
dom = ConstructDomain(DomainStart=Slider(1, range=0..1), DomainEnd=Slider(36, range=0..100))
divide = DivideDomain²(Domain=flip.Surface, UCount=Slider(16, range=0..100), VCount=Slider(14, range=0..100))
lng = ListLength(List=divide)
random = Random(Range=dom, Number=lng, Seed=2)
sbox = SurfaceBox(Surface=flip.Surface, Domain=divide, Height=random)
