# Grasshopper definition edges.gh (Grasshopper 1.0.7)

number_slider = Slider(50, range=0..50)
number_slider_2 = Slider(500, range=0..1000)
crv = Curve(<curve referenced from the Rhino model>)
crv_2 = Curve(<curve referenced from the Rhino model>)
divide = DivideCurve(Curve=crv, Count=number_slider_2, Kinks=False)  # -> Points, Tangents, Parameters
divide_2 = DivideCurve(Curve=crv_2, Count=number_slider_2, Kinks=False)  # -> Points, Tangents, Parameters
brep = Brep(<brep referenced from the Rhino model>)
lng = ListLength(List=divide.Points)
number_slider_3 = Slider(0, range=0..100)
subtraction = Subtraction(A=lng, B=Slider(1, range=0..1))
cull_i = CullIndex(List=divide_2.Points, Indices=flatten([number_slider_3, subtraction]), Wrap=True)
project = Project(Geometry=cull_i, Plane=PlaneXY(0, 0, 0))  # -> Geometry, Transform
cull_i_2 = CullIndex(List=divide.Points, Indices=flatten([number_slider_3, subtraction]), Wrap=True)
vec2pt = Vector2Pt(PointA=cull_i_2, PointB=project.Geometry, Unitize=False)  # -> Vector, Length
X = UnitX(Factor=1)
move = Move(Geometry=brep, Motion=cull_i_2)  # -> Geometry, Transform
ln = Line(StartPoint=cull_i_2, EndPoint=cull_i)
vdis = VectorDisplay(Anchor=cull_i_2, Vector=vec2pt.Vector)
xprod = CrossProduct(VectorA=vec2pt.Vector, VectorB=X, Unitize=Toggle(True))  # -> Vector, Length
len = Length(Curve=ln)
angle = Angle(VectorA=vec2pt.Vector, VectorB=X)  # -> Angle, Reflex
pdecon = Deconstruct(Point=xprod.Vector)  # -> XComponent, YComponent, ZComponent
xz = XZPlane(Origin=Point(0, 0, 0))
vec2pt_2 = Vector2Pt(PointA=cull_i_2, PointB=cull_i, Unitize=False)  # -> Vector, Length
vdis_2 = VectorDisplay(Anchor=cull_i_2, Vector=xprod.Vector)
larger = LargerThan(FirstNumber=pdecon.ZComponent, SecondNumber=Slider(0, range=0..100))  # -> LargerThan, OrEqualTo
angle_2 = Angle(VectorA=vec2pt_2.Vector, VectorB=X, Plane=xz)  # -> Angle, Reflex
dispatch = Dispatch(List=angle.Angle, DispatchPattern=larger.LargerThan)  # -> ListA, ListB
neg = Negative(Value=angle_2.Angle)
index = ItemIndex(List=angle.Angle, Item=dispatch.ListB)
neg_2 = Negative(Value=dispatch.ListB)
deg = Degrees(Radians=neg)
replace = ReplaceItems(List=angle.Angle, Item=neg_2, Indices=index, Wrap=False)
panel = Panel(deg)
addition = Addition(A=Slider(360, range=0..1000), B=panel)
panel_2 = Panel(addition)
deg_2 = Degrees(Radians=replace)
panel_3 = Panel(deg_2)
zrot_num = Number(deg_2)
position_pt = Point(cull_i_2)
length_number = Number(len)
yrot_num = Number(addition)
path = FilePath("/Users/huhuxi/Desktop/new.csv")
c_script = CSharpScript(path=path, positions=position_pt, lengths=length_number, zRots=zrot_num, yRots=yrot_num)  # -> out, A; inputs path: String, positions: list of Point3d, lengths: list of Double, zRots: list of Double, yRots: list of Double
# ---------- c_script: C# usings ----------
using System.IO;
# ---------- c_script: C# ----------
    string[] lines = new string[positions.Count + 1];
    lines[0] = "id,posX,posY,posZ,length,rotY,rotZ";

    for (int i = 0; i < positions.Count; i++){
      string[] elements = new string[7];
      elements[0] = i.ToString();
      elements[1] = positions[i].X.ToString();
      elements[2] = positions[i].Y.ToString();
      elements[3] = positions[i].Z.ToString();
      elements[4] = lengths[i].ToString();
      elements[5] = yRots[i].ToString();
      elements[6] = zRots[i].ToString();
      lines[i + 1] = string.Join(",", elements);
    }

    File.WriteAllLines(path, lines);
# ---------- end c_script ----------
