# Grasshopper definition select.gh (Grasshopper 1.0.7)

mesh = Mesh()
lng = ListLength()
dom = ConstructDomain(DomainStart=0, DomainEnd=lng)
random = Random(Range=dom, Number=Slider(20, range=0..100), Seed=Slider(4, range=0..10))
round = Round(Number=random)  # -> Nearest, Floor, Ceiling
item = ListItem(Index=round.Floor, Wrap=True)
